# Grasshopper definition GHPython_ReadJSONFILE.gh (Grasshopper 1.0.7)

path = FilePath("C:\Users\chifu\Downloads\output.json")
json = PythonScript(FilePath=path, read=Toggle(False))  # -> out, a; inputs read: Boolean
# ---------- json: Python ----------
import json
from Grasshopper.Kernel.Data import GH_Path
from Grasshopper import DataTree
import System

output = DataTree[System.Object]()

if read:
    if FilePath:
        # JSON file to read
        file = open(FilePath)
        # Load the data
        data = json.load(file)
        for i,pt in enumerate(data['pcloud']):
            path=GH_Path(i)
            output.Add(pt['x'],path)
            output.Add(pt['y'],path)
            output.Add(pt['z'],path)

a=output
# ---------- end json ----------
rec = DataRecorder(json.a, DataLimit=-10, RecordData=False)
panel = Panel(json.a)
item = ListItem(List=rec, Index=0, Wrap=True)  # -> Item, Item1, Item2
pt = ConstructPoint(XCoordinate=item.Item, YCoordinate=item.Item1, ZCoordinate=item.Item2)
