# Grasshopper definition building_sortedmesh.gh (Grasshopper 1.0.7)
# plug-ins: MeshEdit Components, Aggregations

aaa = Slider(80, range=0..100)
panel = Panel("START")
pt = ConstructPoint(XCoordinate=aaa, YCoordinate=0, ZCoordinate=0)
# Geometry to be baked
mesh_sphere = MeshSphere(Base=pt, Radius=10, UCount=10, VCount=20)
# base
crv = Curve(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)

number_slider = Slider(6, range=0..100)
number_slider_2 = Slider(12, range=0..100)
box = CenterBox(Base=PlaneXY(0, 0, 0), X=number_slider, Y=number_slider, Z=number_slider_2)
mbox = MeshBox(Base=box, XCount=number_slider, YCount=number_slider, ZCount=number_slider_2)
Z = UnitZ(Factor=number_slider_2)
move = Move(Geometry=mbox, Motion=Z)  # -> Geometry, Transform
explode = MeshExplode(Mesh=move.Geometry, Interpolate=False)

crv_2 = Curve(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)
merge = Merge(Data1=crv, Data2=crv_2)
loft = Loft(Curves=merge, Options={Adjust=False, Closed=False, LoftEnds=0, LoftSimp=0, LoftType=0, Rebuild=10, Refit=0.01})
qrsettings = QuadRemeshSettings(
    TargetCount=Slider(121, range=0..1000),
    AdaptiveSize=0,
    AdaptiveCount=False,
    HardEdges=False,
    SeamEdges=0,
    Symmetry=0,
    GuideCurves=0)
qrmesh = QuadRemesh(Mesh=loft, Settings=qrsettings)

panel_2 = Panel("Bakes another component")
bake_other_components = PythonScript(trigger=mesh_sphere)  # -> out, a
# ---------- bake_other_components: Python ----------
import Rhino as rh
from System.Collections.Generic import *
from System import *
import scriptcontext as sc

#if Go == True:
if sc.sticky["bake"] == True:
    ghdoc = ghenv.Component.Attributes.Owner.OnPingDocument()
    rhdoc = rh.RhinoDoc.ActiveDoc
    componentsToBake = [x for x in ghdoc.ActiveObjects() if x.Name == "Mesh Sphere"]
    for component in componentsToBake:
        ids = List[Guid]()
        component.BakeGeometry(rhdoc,ids)
# ---------- end bake_other_components ----------
# Loops through an upstream slider
crank = SliderCrank(trigger=bake_other_components.a, DOIT=Button())  # -> a; inputs DOIT: Boolean
# ---------- crank: Python ----------
"""
Based on a script by Anders Holden Deleuran
"""

import scriptcontext as sc
import Grasshopper as gh

if DOIT:
    # Reset the count
    sc.sticky["count"] = 0
    
    # Enable the "Bake Other Components" component.
    sc.sticky["bake"] = True

elif sc.sticky["count"]<5:
    sc.sticky["bake"] = True
    # Iterate the GH objects
    for obj in ghenv.Component.OnPingDocument().Objects:
        # Set the named slider values
        
        if obj.NickName == "aaa":
            if type(obj) is gh.Kernel.Special.GH_NumberSlider:
                
                # Set value
                obj.Slider.Value = sc.sticky["count"]*20
                obj.ExpireSolution(True)
    
    # Increment the sticky variable "count"
    sc.sticky["count"] = sc.sticky["count"] + 1

else:
    # Disable the "Bake Other Components" component.
    sc.sticky["bake"] = False
# ---------- end crank ----------
explode_2 = MeshExplode(Mesh=qrmesh, Interpolate=False)
python = GhPythonScript(ms=explode_2, bc=crv, tol=Slider(10, range=0..10))  # -> out, a, b, c; inputs ms: list of Mesh, bc: Curve
# ---------- python: Python ----------
__author__ = "chifu"
__version__ = "2022.11.15"

import rhinoscriptsyntax as rs

from Grasshopper.Kernel.Data import GH_Path
from Grasshopper import DataTree
import System

zs=[]
for m in ms:
    mcz = round(m.GetBoundingBox(True).Center.Z,3)
    # 判斷 Z 方向 約有幾行 mesh
    if len(zs)==0:
        zs.append(mcz)
    # 找所有 zs 若差距均大於 tol 值 才加入這個 mcz
    else:
        for zz in zs:
            zadd = False
            if (abs(mcz-zz)>tol):
                zadd = True
        if (zadd):
            zs.append(mcz)
zs.sort()

# 再整理一次
newz=[]
for i,zz in enumerate(zs):
    if (i ==0):
        newz.append(zz)
#   前後相差大於 tol 才會置入陣列 
    else:
        if (abs(zz-zs[i-1])>tol):
            newz.append(zz)
zs=newz

# !!!!!!!!!!!!! datatree
# 根據 zs 將 z 值在 tol 範圍內的分為一組 
newms = DataTree[System.Object]()
for m in ms:
    mcz = round(m.GetBoundingBox(True).Center.Z,3)
    for i,z in enumerate(zs):
        path=GH_Path(i)
        if (abs(z-mcz)<tol*0.5):
            newms.Add(m,path)
            break

# 根據 輪廓開始點距離 對已有組內容 排序
def order_val(m):
#    t=0.0
    mcp = m.GetBoundingBox(True).Center
    bol,t = bc.ClosestPoint(mcp)
    return t

# !!!!!!!!!!!!! sort datatree
sortedms = DataTree[System.Object]()
for i,b in enumerate(newms.Branches):
    b_sorted = sorted(b, key=lambda m:order_val(m));
    path=GH_Path(i)
    for j,m in enumerate(b_sorted):
#        m.Name = f'm_{i}_{j}'
        sortedms.Add(m,path)
        
a=zs
b=newms
c=sortedms
# ---------- end python ----------
number_slider_3 = Slider(6, range=0..10)

# ----
# 說明4 ：此後生成物件會照該排序生成
geo = Geometry(python.c)
area = Area(Geometry=flatten(geo))  # -> Area, Centroid
points = PointList(Points=area.Centroid, Size=number_slider_3)

# ----
# 說明5 ：針對排序建立名字，確保方向
python_2 = GhPythonScript(ms=geo, tf=Button(), flip=Toggle(True))  # -> out, a; inputs ms: tree of Mesh, tf: Boolean, flip: Boolean
# ---------- python_2: Python ----------
__author__ = "chifu"
__version__ = "2022.11.16"

import rhinoscriptsyntax as rs
import scriptcontext as sc
import Rhino as rh

sc.doc=rh.RhinoDoc.ActiveDoc

if tf:
    # i 為 row | j 為 colum
    for i,row in enumerate(ms.Branches):
        for j,m in enumerate(row):
            # 設定 bake 物件的名字
            attribs = sc.doc.CreateDefaultAttributes()
            attribs.Name = 'm_{}_{}'.format(i,j)
            m.Flip(flip,flip,flip)
            sc.doc.Objects.AddMesh(m, attribs)
# ---------- end python_2 ----------
panel_3 = Panel(python_2.out)

# ----
# 說明0 ：當前混亂排序
area_2 = Area(Geometry=explode_2)  # -> Area, Centroid
points_2 = PointList(Points=area_2.Centroid, Size=number_slider_3)

python_3 = GhPythonScript(x=python.b, y=crv)  # -> out, a; inputs x: list of Mesh, y: Curve
# ---------- python_3: Python ----------
__author__ = "chifu"
__version__ = "2022.11.16"

import rhinoscriptsyntax as rs

def order_val(m):
#    t=0.0
    mcp = m.GetBoundingBox(True).Center
    bol,t = y.ClosestPoint(mcp)
    return t

bcp=y.PointAtStart
mar=[]
for m in x:
    mar.append([m,order_val(m)])
    
ms_sorted = sorted(x, key=lambda m:order_val(m));

# 將點拉到線上
# 找線上點在線上的 t 值
# 回傳 t 值

#k=order_val(x[2])

a = ms_sorted
# ---------- end python_3 ----------
# 說明2 ：需每層組內排序
area_3 = Area(Geometry=python.b)  # -> Area, Centroid
points_3 = PointList(Points=area_3.Centroid, Size=number_slider_3)

# ----
# 說明3 ：每層正確排序
area_4 = Area(Geometry=python.c)  # -> Area, Centroid
points_4 = PointList(Points=area_4.Centroid, Size=number_slider_3)

panel_4 = Panel(python_3.a)
# 說明1 ：針對Z進行每層分組
panel_5 = Panel(python.a)

geo_2 = Geometry(flatten(explode_2))
area_5 = MeshArea(Mesh=geo_2)  # -> Area, Centroid
facen = FaceNormals(Mesh=geo_2)  # -> flatten(Centers), flatten(Normals)
lng = ListLength(List=area_5.Centroid)
pl = PlaneNormal(Origin=facen.Centers, ZAxis=facen.Normals)
series = Series(Start=0, Step=1, Count=lng)
rotate = Rotate(Geometry=pl, Angle=degrees(Slider(-180, range=-180..180)), Plane=pl)  # -> Geometry, Transform
text = Text(Location=rotate.Geometry, Text=series, Size=number_slider_3, Bold=False, HorizontalAlignment=0, VerticalAlignment=0)
